# Grasshopper definition hole.gh (Grasshopper 0.9.80)
# plug-ins: Python Interpreter

enum = PythonScript()  # -> enum
# ---------- enum: Python ----------
__author__ = "cha84rakanal"

import rhinoscriptsyntax as rs

enumSize = [0.01,0.02,0.03,0.04,0.05,0.06,0.07,0.08,0.09,0.10,0.20,0.30,0.40,0.50,0.60,0.70,0.80,0.90,1.00]

enum = enumSize
# ---------- end enum ----------
lng = ListLength(List=enum)
division = Division(A=enum, B=2)
series = Series(Start=0, Step=2, Count=lng)
polygon = Polygon(Plane=PlaneXY(0, 0, 0), Radius=division, Segments=3, FilletRadius=0)  # -> Polygon, Length
polygon_2 = Polygon(Plane=PlaneXY(0, 0, 0), Radius=division, Segments=4, FilletRadius=0)  # -> Polygon, Length
polygon_3 = Polygon(Plane=PlaneXY(0, 0, 0), Radius=division, Segments=5, FilletRadius=0)  # -> Polygon, Length
polygon_4 = Polygon(Plane=PlaneXY(0, 0, 0), Radius=division, Segments=6, FilletRadius=0)  # -> Polygon, Length
cir = Circle(Plane=PlaneXY(0, 0, 0), Radius=division)
vec = VectorXYZ(XComponent=series, YComponent=0, ZComponent=0)  # -> Vector, Length
vec_2 = VectorXYZ(XComponent=series, YComponent=2, ZComponent=0)  # -> Vector, Length
vec_3 = VectorXYZ(XComponent=series, YComponent=4, ZComponent=0)  # -> Vector, Length
vec_4 = VectorXYZ(XComponent=series, YComponent=6, ZComponent=0)  # -> Vector, Length
vec_5 = VectorXYZ(XComponent=series, YComponent=8, ZComponent=0)  # -> Vector, Length
move = Move(Geometry=cir, Motion=vec.Vector)  # -> Geometry, Transform
move_2 = Move(Geometry=polygon.Polygon, Motion=vec_2.Vector)  # -> Geometry, Transform
move_3 = Move(Geometry=polygon_2.Polygon, Motion=vec_3.Vector)  # -> Geometry, Transform
move_4 = Move(Geometry=polygon_3.Polygon, Motion=vec_4.Vector)  # -> Geometry, Transform
move_5 = Move(Geometry=polygon_4.Polygon, Motion=vec_5.Vector)  # -> Geometry, Transform
pt = Point(Point(0, 0, 50))
boundary = BoundarySurfaces(Edges=[move.Geometry, move_2.Geometry, move_3.Geometry, move_4.Geometry, move_5.Geometry])
pt_2 = Point(Point(-2, -2, 2.5))
pt_3 = Point(Point(38, 10, 47.5))
extr = Extrude(Base=boundary, Direction=pt)
box = Box2Pt(PointA=pt_2, PointB=pt_3, Plane=PlaneXY(0, 0, 0))
sdiff = SolidDifference(BrepsA=box, BrepsB=extr)
