# Grasshopper definition shita.gh (Grasshopper 0.9.80)
# plug-ins: Python Interpreter

panel = Panel("リスト")
list = ValueList({"10 μm": 0.010, "20 μm": 0.020, "30 μm": 0.030, "40 μm": 0.040, "50 μm": 0.050, "60 μm": 0.060, "70 μm": 0.070, "80 μm": 0.080, "90 μm": 0.090, "100 μm": 0.100, "200 μm": 0.200, "300 μm": 0.300, "400 μm": 0.400, "500 μm": 0.500, "600 μm": 0.600, "700 μm": 0.700, "800 μm": 0.800, "900 μm": 0.900, "1000 μm": 1.000}, selected="10 μm")

number_slider = Slider(5, range=1..10)
list_2 = ValueList({"10 μm": 0.010, "20 μm": 0.020, "30 μm": 0.030, "40 μm": 0.040, "50 μm": 0.050, "60 μm": 0.060, "70 μm": 0.070, "80 μm": 0.080, "90 μm": 0.090, "100 μm": 0.100, "200 μm": 0.200, "300 μm": 0.300, "400 μm": 0.400, "500 μm": 0.500, "600 μm": 0.600, "700 μm": 0.700, "800 μm": 0.800, "900 μm": 0.900, "1000 μm": 1.000}, selected="10 μm")
panel_2 = Panel("幅")
num = Number(list_2)

panel_3 = Panel("高さ")
list_3 = ValueList({"10 μm": 0.010, "20 μm": 0.020, "30 μm": 0.030, "40 μm": 0.040, "50 μm": 0.050, "60 μm": 0.060, "70 μm": 0.070, "80 μm": 0.080, "90 μm": 0.090, "100 μm": 0.100, "200 μm": 0.200, "300 μm": 0.300, "400 μm": 0.400, "500 μm": 0.500, "600 μm": 0.600, "700 μm": 0.700, "800 μm": 0.800, "900 μm": 0.900, "1000 μm": 1.000}, selected="20 μm")
neg = Negative(Value=Slider(2, range=1..10))

number_slider_2 = Slider(5, range=1..10)
origin = Point(Point(0, 0, 0))
pt = ConstructPoint(XCoordinate=num, YCoordinate=number_slider_2, ZCoordinate=neg)
panel_4 = Panel("基本コンポーネント")
box = Box2Pt(PointA=origin, PointB=pt, Plane=PlaneXY(0, 0, 0))

origin_2 = Point(Point(0, 0, 0))
panel_5 = Panel("ベース")
pt_2 = Point(Point(45, 45, 5))
box_2 = Box2Pt(PointA=origin_2, PointB=pt_2, Plane=PlaneXY(0, 0, 0))

list_4 = ValueList({"10 μm": 0.010, "20 μm": 0.020, "30 μm": 0.030, "40 μm": 0.040, "50 μm": 0.050, "60 μm": 0.060, "70 μm": 0.070, "80 μm": 0.080, "90 μm": 0.090, "100 μm": 0.100, "200 μm": 0.200, "300 μm": 0.300, "400 μm": 0.400, "500 μm": 0.500, "600 μm": 0.600, "700 μm": 0.700, "800 μm": 0.800, "900 μm": 0.900, "1000 μm": 1.000}, selected="10 μm")
addition = Addition(A=Slider(2, range=1..10), B=number_slider_2)
panel_6 = Panel("縦方向オフセット")
series = Series(Start=0, Step=addition, Count=Slider(6, range=1..30))

list_5 = ValueList({"10 μm": 0.010, "20 μm": 0.020, "30 μm": 0.030, "40 μm": 0.040, "50 μm": 0.050, "60 μm": 0.060, "70 μm": 0.070, "80 μm": 0.080, "90 μm": 0.090, "100 μm": 0.100, "200 μm": 0.200, "300 μm": 0.300, "400 μm": 0.400, "500 μm": 0.500, "600 μm": 0.600, "700 μm": 0.700, "800 μm": 0.800, "900 μm": 0.900, "1000 μm": 1.000}, selected="10 μm")
addition_2 = Addition(A=num, B=Slider(2, range=1..10))
panel_7 = Panel("横方向オフセット")
series_2 = Series(Start=0, Step=addition_2, Count=Slider(22, range=1..30))  # -> graft(Series)

panel_8 = Panel("原点オフセット")
pt_3 = ConstructPoint(XCoordinate=Slider(2, range=1..10), YCoordinate=Slider(2, range=1..10), ZCoordinate=Slider(5, range=1..10))

python = PythonScript()  # -> out, a
# ---------- python: Python ----------
__author__ = "cha84rakanal"

import rhinoscriptsyntax as rs
rs.Command("_Line 0,0,0 2,2,2")
# ---------- end python ----------

pt_4 = ConstructPoint(XCoordinate=series_2, YCoordinate=series, ZCoordinate=0)
addition_3 = Addition(A=pt_3, B=pt_4)
panel_9 = Panel("移動")
move = Move(Geometry=box, Motion=addition_3)  # -> simplify(flatten(Geometry)), Transform

dam = DataDam(DataA=move.Geometry, BufferDelay=10000000, BufferMode=0)
sdiff = SolidDifference(BrepsA=box_2, BrepsB=dam)
sunion = SolidUnion(Breps=dam)
