# Grasshopper definition test_model.gh (Grasshopper 0.9.80)

panel = Panel("リスト")
list = ValueList({"10 μm": 0.010, "20 μm": 0.020, "30 μm": 0.030, "40 μm": 0.040, "50 μm": 0.050, "60 μm": 0.060, "70 μm": 0.070, "80 μm": 0.080, "90 μm": 0.090, "100 μm": 0.100, "200 μm": 0.200, "300 μm": 0.300, "400 μm": 0.400, "500 μm": 0.500, "600 μm": 0.600, "700 μm": 0.700, "800 μm": 0.800, "900 μm": 0.900, "1000 μm": 1.000}, selected="10 μm")

number_slider = Slider(5, range=1..10)
panel_2 = Panel("幅")
list_2 = ValueList({"10 μm": 0.010, "20 μm": 0.020, "30 μm": 0.030, "40 μm": 0.040, "50 μm": 0.050, "60 μm": 0.060, "70 μm": 0.070, "80 μm": 0.080, "90 μm": 0.090, "100 μm": 0.100, "200 μm": 0.200, "300 μm": 0.300, "400 μm": 0.400, "500 μm": 0.500, "600 μm": 0.600, "700 μm": 0.700, "800 μm": 0.800, "900 μm": 0.900, "1000 μm": 1.000}, selected="10 μm")

panel_3 = Panel("高さ")
list_3 = ValueList({"10 μm": 0.010, "20 μm": 0.020, "30 μm": 0.030, "40 μm": 0.040, "50 μm": 0.050, "60 μm": 0.060, "70 μm": 0.070, "80 μm": 0.080, "90 μm": 0.090, "100 μm": 0.100, "200 μm": 0.200, "300 μm": 0.300, "400 μm": 0.400, "500 μm": 0.500, "600 μm": 0.600, "700 μm": 0.700, "800 μm": 0.800, "900 μm": 0.900, "1000 μm": 1.000}, selected="20 μm")

origin = Point(Point(0, 0, 0))
pt = ConstructPoint(XCoordinate=list_2, YCoordinate=Slider(5, range=1..10), ZCoordinate=Slider(2, range=1..10))
panel_4 = Panel("基本コンポーネント")
box = Box2Pt(PointA=origin, PointB=pt, Plane=PlaneXY(0, 0, 0))

origin_2 = Point(Point(0, 0, 0))
panel_5 = Panel("ベース")
pt_2 = Point(Point(45, 45, 5))
box_2 = Box2Pt(PointA=origin_2, PointB=pt_2, Plane=PlaneXY(0, 0, 0))
