# Grasshopper definition variavble.gh (Grasshopper 0.9.80)
# plug-ins: Python Interpreter

panel = Panel("リスト")
list = ValueList({"10 μm": 0.010, "20 μm": 0.020, "30 μm": 0.030, "40 μm": 0.040, "50 μm": 0.050, "60 μm": 0.060, "70 μm": 0.070, "80 μm": 0.080, "90 μm": 0.090, "100 μm": 0.100, "200 μm": 0.200, "300 μm": 0.300, "400 μm": 0.400, "500 μm": 0.500, "600 μm": 0.600, "700 μm": 0.700, "800 μm": 0.800, "900 μm": 0.900, "1000 μm": 1.000}, selected="10 μm")

pt = ConstructPoint(XCoordinate=Slider(160, range=10..200), YCoordinate=Slider(45, range=10..200), ZCoordinate=Slider(5, range=1..10))
origin = Point(Point(0, 0, 0))
panel_2 = Panel("ベース")
pt_2 = Point(pt)
box = Box2Pt(PointA=origin, PointB=pt_2, Plane=PlaneXY(0, 0, 0))

number_slider = Slider(5, range=1..10)
list_2 = ValueList({"10 μm": 0.010, "20 μm": 0.020, "30 μm": 0.030, "40 μm": 0.040, "50 μm": 0.050, "60 μm": 0.060, "70 μm": 0.070, "80 μm": 0.080, "90 μm": 0.090, "100 μm": 0.100, "200 μm": 0.200, "300 μm": 0.300, "400 μm": 0.400, "500 μm": 0.500, "600 μm": 0.600, "700 μm": 0.700, "800 μm": 0.800, "900 μm": 0.900, "1000 μm": 1.000}, selected="10 μm")
panel_3 = Panel("幅")
num = Number(list_2)

panel_4 = Panel("高さ")
list_3 = ValueList({"10 μm": 0.010, "20 μm": 0.020, "30 μm": 0.030, "40 μm": 0.040, "50 μm": 0.050, "60 μm": 0.060, "70 μm": 0.070, "80 μm": 0.080, "90 μm": 0.090, "100 μm": 0.100, "200 μm": 0.200, "300 μm": 0.300, "400 μm": 0.400, "500 μm": 0.500, "600 μm": 0.600, "700 μm": 0.700, "800 μm": 0.800, "900 μm": 0.900, "1000 μm": 1.000}, selected="20 μm")
neg = Negative(Value=Slider(2, range=1..10))

origin_2 = Point(Point(0, 0, 0))
pt_3 = ConstructPoint(XCoordinate=num, YCoordinate=Slider(5, range=1..10), ZCoordinate=neg)
panel_5 = Panel("基本コンポーネント")
box_2 = Box2Pt(PointA=origin_2, PointB=pt_3, Plane=PlaneXY(0, 0, 0))

pdecon = Deconstruct(Point=pt_2)  # -> XComponent, YComponent, ZComponent
number_slider_2 = Slider(3, range=1..100)
x_height_variable = PythonScript(eachX=number_slider_2, xsize=pdecon.XComponent, ysize=pdecon.YComponent)  # -> boxOrigin, boxSize
# ---------- x_height_variable: Python ----------
__author__ = "cha84rakanal"

import rhinoscriptsyntax as rs
from Rhino.Geometry import Point3d, Line

enumSize = [0.01,0.02,0.03,0.04,0.05,0.06,0.07,0.08,0.09,0.10,0.20,0.30,0.40,0.50,0.60,0.70,0.80,0.90,1.00]

fixedZ = 2
fixedY = 5
fixedX = 0.4

sparation = 2

#unit [mm]
boxOrigin = []
boxSize = []

y = 0
while y < ysize - sparation - fixedY:
	x = 0
	index = 0
	cnt = 0
	while x < xsize - sparation:
		boxOrigin.append(Point3d(x,y,0))
		boxSize.append(Point3d(x + fixedX,y + fixedY,enumSize[index]))
		x = x + fixedX + sparation
		cnt = cnt + 1
		if cnt >= eachX:
			cnt = 0
			index = index + 1 #ここ
			if index >= 19:
				x = x + 100
			x = x + 1
	y = y + sparation + fixedY
# ---------- end x_height_variable ----------
x_thickness_variable = PythonScript(eachX=number_slider_2, xsize=pdecon.XComponent, ysize=pdecon.YComponent)  # -> boxOrigin, boxSize
# ---------- x_thickness_variable: Python ----------
__author__ = "cha84rakanal"

import rhinoscriptsyntax as rs
from Rhino.Geometry import Point3d, Line

enumSize = [0.01,0.02,0.03,0.04,0.05,0.06,0.07,0.08,0.09,0.10,0.20,0.30,0.40,0.50,0.60,0.70,0.80,0.90,1.00]

fixedZ = 2
fixedY = 5

sparation = 2

#unit [mm]
boxOrigin = []
boxSize = []

y = 0
while y < ysize - sparation - fixedY:
	x = 0
	index = 0
	cnt = 0
	while x < xsize - sparation:
		boxOrigin.append(Point3d(x,y,0))
		boxSize.append(Point3d(x + enumSize[index],y + fixedY,fixedZ))
		x = x + enumSize[index] + sparation
		cnt = cnt + 1
		if cnt >= eachX:
			cnt = 0
			index = index + 1 #ここ
			x = x + 2
	y = y + sparation + fixedY
# ---------- end x_thickness_variable ----------
pt_4 = Point(x_height_variable.boxOrigin)
pt_5 = Point(x_height_variable.boxSize)
box_3 = Box2Pt(PointA=pt_4, PointB=pt_5, Plane=PlaneXY(0, 0, 0))

panel_6 = Panel("原点オフセット")
pt_6 = ConstructPoint(XCoordinate=Slider(2, range=1..10), YCoordinate=Slider(2, range=1..10), ZCoordinate=Slider(5, range=1..10))

move = Move(Geometry=box_3, Motion=pt_6)  # -> simplify(flatten(Geometry)), Transform
box_4 = Box(move.Geometry)
dam = DataDam(DataA=box_4, BufferDelay=10000000, BufferMode=0)
sdiff = SolidDifference(BrepsA=box, BrepsB=dam)
sunion = SolidUnion(Breps=[box, dam])
